# Grasshopper definition SynapseExample.gh (Grasshopper 1.0.7)
# plug-ins: Synapse

panel = Panel("""DecimalPlaces
Increment""")
panel_2 = Panel("""TickFrequency
Width""")
argb = SplitARGB(Colour=ColourSwatch(SwatchColor=RGB(50, 132, 209)), IntegerChannels=True)  # -> Alpha, Red, Green, Blue
scolor = SynapseColor(Alpha=argb.Alpha, Red=argb.Red, Green=argb.Green, Blue=argb.Blue)
sfont = SynapseFont(FontFamily="Lucida Console", FontSize=8.25, FontStyle=0, Decoration=0)
panel_3 = Panel("""2
2""")
int = Integer("10")
int_2 = Integer("136")
stb = SynapseTextBox(Mask="(000) 000 0000")  # -> AllProperties, Control, AllMasks
int_3 = Integer(panel_3)
scheckbox = SynapseCheckBox(Property=flatten("TextColor"), PropertyValue=flatten(ColourSwatch(SwatchColor=RGB(178, 43, 154))))  # -> AllProperties, Control
sbutton = SynapseButton(Property=flatten("Font"), PropertyValue=flatten(sfont))  # -> AllProperties, Control
slabel = SynapseLabel(Property=flatten("text"), PropertyValue=flatten("object name"))  # -> AllProperties, Control
snud = SynapseNumUpDn(Property=flatten(panel), PropertyValue=flatten(int_3))  # -> AllProperties, Control
sslider = SynapseSlider(Property=flatten(panel_2), PropertyValue=flatten([int, int_2]))  # -> AllProperties, Control
stextbox = SynapseTextBox(Property=flatten("TextColor"), PropertyValue=flatten(scolor))  # -> AllProperties, Control
pickone = SynapseSingleSelect(Options=flatten(["Alpha", "Beta", "Omega"]))  # -> AllProperties, Control
panel_4 = Panel(stb.AllMasks)
X = Slider(28, range=1..50, expression="x*10")
# some properties won't convert data type automatically;
# manually enforce the integer type
D = Slider(14, range=5..20)
panel_5 = Panel("""tab0
tab1
tab2""")
size = SynapseSize(Width=Slider(143, range=100..800), Height=Slider(220, range=100..800))
combo = SynapseComboBox(Options=flatten(["Alpha", "Beta", "Omega"]))  # -> AllProperties, Control
int_4 = Integer(X)
int_5 = Integer(D)
listbox = SynapseListBox(Options=flatten(panel_5))  # -> AllProperties, Control
merge = Merge(Data1=scheckbox.Control, Data2=sbutton.Control, Data3=slabel.Control, Data4=snud.Control)
merge_2 = Merge(Data1=sslider.Control, Data2=stb.Control, Data3=pickone.Control)
merge_3 = Merge(Data1=flatten(int_5), Data2=flatten(int_5), Data3=int_4)
merge_4 = Merge(
    Data1=flatten(scheckbox.Control),
    Data2=flatten(sbutton.Control),
    Data3=flatten(slabel.Control),
    Data4=flatten(pickone.Control),
    Data5=flatten(snud.Control),
    Data6=flatten(sslider.Control),
    Data7=flatten(stextbox.Control))
sstack = SynapseStack(Property=flatten("Size"), PropertyValue=flatten(size), Controls=flatten(merge))  # -> AllProperties, Control
sstack_2 = SynapseStack(Property=flatten("Size"), PropertyValue=flatten(size), Controls=flatten(merge_2))  # -> AllProperties, Control
sstack_3 = SynapseStack(Property=flatten("Size"), PropertyValue=flatten(size), Controls=flatten([listbox.Control, combo.Control]))  # -> AllProperties, Control
panel_6 = Panel("""padding
spacing
Width""")
txy = SynapseTableXY(Controls=merge_4, Columns=2)  # -> Coordinates, Dimensions
value = ValueQuery(SynapseObject=merge_4)
value_2 = ValueQuery(SynapseObject=combo.Control)
tab = SynapseTabs(Controls=flatten([sstack.Control, sstack_2.Control, sstack_3.Control]), TabName=flatten(panel_5))  # -> AllProperties, Control
argb_2 = SplitARGB(Colour=ColourSwatch(SwatchColor=RGB(237, 236, 230)), IntegerChannels=True)  # -> Alpha, Red, Green, Blue
table = SynapseTable(
    Property=flatten(panel_6),
    PropertyValue=flatten(merge_3),
    Controls=flatten(merge_4),
    ControlLocation=flatten(txy.Coordinates),
    TableDimension=txy.Dimensions)  # -> AllProperties, Control; disabled
scolor_2 = SynapseColor(Alpha=argb_2.Alpha, Red=argb_2.Red, Green=argb_2.Green, Blue=argb_2.Blue)
watcher = Panel(value_2)
Y = Slider(23, range=1..50, expression="x*10")
X_2 = Slider(30, range=1..50, expression="x*10")
topmost = BooleanToggle(True)
pypt = GhPythonScript(x=Slider(50, range=1..50, expression="x*10"), y=Slider(50, range=1..50, expression="x*10"))  # -> out, p; inputs x: Int32, y: Int32
# ---------- pypt: Python ----------
"""creating an Eto.Drawing.Point object for Synapse plugin to consume.
    Inputs:
        x: x coordinate
        y: y coordinate
    Output:
        p: point object"""

__author__ = "wwang"
__version__ = "2021.02.19"

import Eto.Drawing as drw

p = drw.Point(x,y)
# ---------- end pypt ----------
vec = VectorXYZ(XComponent=X_2, YComponent=Y, ZComponent=0)  # -> Vector, Length
merge_5 = Merge(
    Data1=flatten(scolor_2),
    Data2=flatten("NimbleDashboard"),
    Data3=flatten(pypt.p),
    Data4=flatten(vec.Vector),
    Data5=flatten(topmost))
panel_7 = Panel("""color
title
Location
size
Topmost""")
list = ValueList({"Show": True, "Closed": False}, selected="Closed")
swindow = SynapseWindow(Show=list, Property=flatten(panel_7), PropertyValue=flatten(merge_5), Contents=flatten(tab.Control), ctrlfill=False)
